# Grasshopper definition test4.ghx (Grasshopper 1.0.7)

lengte = Slider(4000, range=4000..26000)
toog = Slider(200, range=100..1000)
division = Division(A=lengte, B="2")
division_2 = Division(A=lengte, B="50")
subtraction = Subtraction(A=toog, B=division_2)
pt = ConstructPoint(XCoordinate="0", YCoordinate="0", ZCoordinate="0")
pt_2 = ConstructPoint(XCoordinate=division, YCoordinate="0", ZCoordinate=toog)
pt_3 = ConstructPoint(XCoordinate=lengte, YCoordinate="0", ZCoordinate="0")
neg = Negative(Value=division_2)
arc = Arc3Pt(PointA=pt, PointB=pt_2, PointC=pt_3)  # -> Arc, Plane, Radius
pt_4 = ConstructPoint(XCoordinate="0", YCoordinate=division_2, ZCoordinate=neg)
pt_5 = ConstructPoint(XCoordinate=division, YCoordinate=division_2, ZCoordinate=subtraction)
pt_6 = ConstructPoint(XCoordinate=lengte, YCoordinate=division_2, ZCoordinate=neg)
arc_2 = Arc3Pt(PointA=pt_4, PointB=pt_5, PointC=pt_6)  # -> Arc, Plane, Radius
rulesrf = RuledSurface(CurveA=arc.Arc, CurveB=arc_2.Arc)
